% Simulink data dictionary Scenario.sldd

time = struct(value=604800, unit="sec", description="Integration time")

BeaconSpacecraft = struct(
  mass=struct(value=25, unit="kg", description="Spacecraft mass"),
  radius=struct(
    value=0.1595769,
    unit="m",
    description="Equivalent radius of a sphere with the same surface area of a 12u (20x20x30 cm) cubesat"),
  antenna=struct(area=struct(value=0.04, unit="m^2", description="Effective area of the antenna")),
  rp_coeff=struct(value=1.3, unit="", description="Radiation pressure coefficient"),
  x0=struct(
    value=[6363.961; 6363.961; 0],
    unit="km",
    description="Initial position of the spacecraft in MCI;kep: a=9000km, e=0, i = 45deg, Raan=45deg, argP=0, theta=0 "),
  v0=struct(
    value=[-0.3689429; 0.3689429; 0.5217641],
    unit="km/s",
    description="Initial velocity of the spacecraft in MCI"),
  q0=struct(
    value=[5.887847e-17; 0.7071068; -0.5; -0.5],
    unit="",
    description="Initial attitude of the spacecraft w.r.t MCI"))

simulationDataBus = Simulink.Bus()
  celestialBodies: Bus: celestialBodies
  beaconSpacecraft: Bus: spacecraftState
  mainSpacecraft: Bus: spacecraftState

MainSpacecraft = struct(
  mass=struct(value=25, unit="kg", description="Spacecraft mass"),
  radius=struct(
    value=0.1595769,
    unit="m",
    description="Equivalent radius of a sphere with the same surface area of a 12u (20x20x30 cm) cubesat"),
  antenna=struct(area=struct(value=0.0025, unit="m^2", description="Effective area of the antenna")),
  rp_coeff=struct(value=1.3, unit="", description="Radiation pressure coefficient"),
  x0=struct(
    value=[1.224647e-13; 2000; 0],
    unit="km",
    description="Initial position of the spacecraft in MCI;kep: a=2000km, e=0, i = 45deg, Raan=90deg, argP=0, theta=0 "),
  v0=struct(
    value=[-1.106829; 6.777372e-17; 1.106829],
    unit="km/s",
    description="Initial velocity of the spacecraft in MCI"),
  q0=struct(
    value=[-0.2705981; 0.6532815; -0.6532815; -0.2705981],
    unit="",
    description="Initial attitude of the spacecraft w.r.t MCI"))

celestialBodies = Simulink.Bus()
  Sun: double[3 1], Unit="km"  % Sun's position wrt to the moon
  Mercury: double[3 1], Unit="km"  % Mercury's postion wrt the moon
  Venus: double[3 1], Unit="km"  % Venus' position wrt to the moon
  Earth: double[3 1], Unit="km"  % Earth's position wrt to the moon
  Mars: double[3 1], Unit="km"  % Mars' position wrt to the moon
  Jupiter: double[3 1], Unit="km"  % Jupiter's position wrt to the moon
  Saturn: double[3 1], Unit="km"  % Saturn's position wrt to the moon
  Uranus: double[3 1], Unit="km"  % Uranus' position wrt to the moon
  Neptune: double[3 1], Unit="km"  % Neptune's position wrt to the moon
  Pluto: double[3 1], Unit="km"  % Pluto's position wrt to the moon
  Moon: double[3 1], Unit="km"  % Moon position wrt the moon
  J2000ToMPA: double[6 6]  % 6x6 rotation from J2000 to MPA refernce frame

spacecraftState = Simulink.Bus()  % Spacecraft's simulation data
  x: double[3 1], Unit="km"  % Spacecraft position
  v: double[3 1], Unit="km/s"  % Spacecraft velocity
  w: double[3 1], Unit="rad/s"  % Spacecraft angular rates
  q: double[4 1]  % Spacecraft orientation wrt J2000 (quaternions scalar last)
  a: Bus: accelerations

accelerations = Simulink.Bus()
  Sun: double[3 1], Unit="km/s^2"  % Acceleration caused by the sun's gravity
  Mercury: double[3 1], Unit="km/s^2"  % Acceleration caused by mercury's gravity
  Venus: double[3 1], Unit="km/s^2"  % Acceleration caused by venus's gravity
  Earth: double[3 1], Unit="km/s^2"  % Acceleration caused by earth's gravity
  Mars: double[3 1], Unit="km/s^2"  % Acceleration caused by mars's gravity
  Jupiter: double[3 1], Unit="km/s^2"  % Acceleration caused by jupiter's gravity
  Saturn: double[3 1], Unit="km/s^2"  % Acceleration caused by saturn's gravity
  Uranus: double[3 1], Unit="km/s^2"  % Acceleration caused by uranus's gravity
  Neptune: double[3 1], Unit="km/s^2"  % Acceleration caused by Neptune's gravity
  Pluto: double[3 1], Unit="km/s^2"  % Acceleration caused by pluto's gravity
  Moon_point_mass: double[3 1], Unit="km/s^2"  % Acceleration caused by moon's point mass gravity
  Moon_sh: double[3 1], Unit="km/s^2"  % Acceleration caused by the moon's spherical harmonics  gravity
  srp: double[3 1], Unit="km/s^2"  % Acceleration caused by the solar radiation pressure

Environment = struct(
  Sun=struct(
    mu=struct(value=132712440018, unit="km^3/s^2"),
    radius=struct(value=696000, unit="km"),
    P=struct(description="Solar radiation pressure", unit="Nkm-2", value=4.56)),
  Mercury=struct(mu=struct(value=22032, unit="km^3/s^2")),
  Venus=struct(mu=struct(value=324859, unit="km^3/s^2")),
  Earth=struct(mu=struct(value=398600, unit="km^3/s^2"), radius=struct(unit="km", value=6378.1363)),
  Moon=struct(
    mu=struct(value=4900.2800238, unit="km^3/s^2"),
    radius=struct(value=1738, unit="km"),
    orientation=struct(
      type="ZXZ",
      value=[1.948484 0.3819133 -0.008436886
       1.948644 0.3819134 -0.008436993
       1.948803 0.3819135 -0.008437099
       1.948963 0.3819136 -0.008437206
       1.949123 0.3819136 -0.008437313
       1.949283 0.3819137 -0.008437419
       1.949443 0.3819138 -0.008437525
       1.949602 0.3819139 -0.008437632
       1.949762 0.381914 -0.008437738
       1.949922 0.3819141 -0.008437845
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       ],
      unit="rad",
      description="ZXZ rotation angles from J2000 to MOON_PA"),
    jd_interval=struct(
      value=[2460594 2460594 2460594 2460594 2460594 2460594 2460594 2460594 2460594 2460594.00625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 2460601],
      unit="julian date",
      description="Interpolation points for Environment.Moon.eul"),
    orientation_dot=struct(
      unit="rad/s",
      description="Time derivative of the ZXZ rotation angles from J2000 to MOON_PA",
      value=[2.663365e-06 1.393746e-09 -1.778105e-09
       2.663364e-06 1.39394e-09 -1.777435e-09
       2.663364e-06 1.394134e-09 -1.776764e-09
       2.663363e-06 1.394328e-09 -1.776094e-09
       2.663362e-06 1.394522e-09 -1.775423e-09
       2.663362e-06 1.394716e-09 -1.774752e-09
       2.663361e-06 1.394909e-09 -1.774081e-09
       2.66336e-06 1.395103e-09 -1.77341e-09
       2.66336e-06 1.395297e-09 -1.772739e-09
       2.663359e-06 1.395491e-09 -1.772068e-09
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       ]),
    SH=struct(
      n=struct(value=10, description="degree index"),
      m=struct(value=10, description="order index"),
      csi=struct(
        value=[0 0 0 0 0 0 0 0 0 0 0
         0 0 0 0 0 0 0 0 0 0 0
         1.936492 2.236068 0 0 0 0 0 0 0 0 0
         1.972027 2.09165 2.645751 0 0 0 0 0 0 0 0
         1.984313 2.04939 2.291288 3 0 0 0 0 0 0 0
         1.989975 2.03101 2.171241 2.487469 3.316625 0 0 0 0 0 0
         1.993043 2.021315 2.113942 2.301368 2.673948 3.605551 0 0 0 0 0
         1.994891 2.015564 2.081666 2.20794 2.430862 2.850439 3.872983 0 0 0 0
         1.99609 2.01187 2.061553 2.153222 2.304886 2.557042 3.017804 4.123106 0 0 0
         1.996911 2.009353 2.048122 2.118044 2.229177 2.401636 2.679138 3.177066 4.358899 0 0
         1.997498 2.007561 2.038688 2.093947 2.179449 2.306513 2.496873 2.797057 3.329164 4.582576 0],
        description="coefficients to propagate the Legendre polynomials"),
      eta=struct(
        value=[0 0 0 0 0 0 0 0 0 0 0
         0 0 0 0 0 0 0 0 0 0 0
         1.118034 0 0 0 0 0 0 0 0 0 0
         1.01835 0.9354143 0 0 0 0 0 0 0 0 0
         1.006231 0.9797959 0.8660254 0 0 0 0 0 0 0 0
         1.002853 0.9910312 0.9476071 0.8291562 0 0 0 0 0 0 0
         1.001542 0.9952267 0.9736101 0.9251849 0.8062258 0 0 0 0 0 0
         1.000927 0.997155 0.9847319 0.9594032 0.9090909 0.7905694 0 0 0 0 0
         1.000601 0.9981668 0.9903379 0.9752174 0.9481764 0.8970695 0.7791937 0 0 0 0
         1.000411 0.9987492 0.9934853 0.9836628 0.9671528 0.9392246 0.8877771 0.7705518 0 0 0
         1.000294 0.9991083 0.9953938 0.9886231 0.9776924 0.9603921 0.931969 0.88039 0.7637626 0 0],
        description="coefficients to propagate the Legendre polynomials"),
      Cnm=struct(
        value=[0 0 0 0 0 0 0 0 0 0 0
         0 0 0 0 0 0 0 0 0 0 0
         -9.089015e-05 -2.962036e-08 3.463209e-05 0 0 0 0 0 0 0 0
         -3.24496e-06 2.638547e-05 1.419184e-05 1.228156e-05 0 0 0 0 0 0 0
         3.286678e-06 -5.978221e-06 -7.150751e-06 -1.359494e-06 -6.001626e-06 0 0 0 0 0 0
         -2.530739e-07 -1.144613e-06 4.419088e-06 5.473673e-07 2.74319e-06 3.046958e-06 0 0 0 0 0
         3.691945e-06 1.642643e-06 -4.232775e-06 -3.372817e-06 1.689058e-07 1.433699e-06 -4.560226e-06 0 0 0 0
         5.694974e-06 7.586529e-06 -7.75576e-07 4.16114e-07 -8.55206e-07 9.966364e-08 -9.627454e-07 -1.989445e-06 0 0 0
         2.288258e-06 -6.89421022522e-8 3.001645e-06 -1.878161e-06 3.633517e-06 -1.053987e-06 -2.091723e-06 -1.734175e-06 -2.320601e-06 0 0
         -3.468665e-06 2.113954e-06 1.855938e-06 -2.063234e-06 -1.6956e-06 -1.81353e-06 -2.599316e-06 -3.467338e-06 -9.602593e-07 -1.032916e-06 0
         -8.431876e-07 6.177881e-07 7.837813e-08 6.521969e-07 -3.429879e-06 3.111767e-07 5.080282e-08 -3.232749e-06 -3.83168e-06 -5.183202e-06 9.152631e-07],
        description="S.h. sine coefficients"),
      Snm=struct(
        value=[0 0 0 0 0 0 0 0 0 0 0
         0 0 0 0 0 0 0 0 0 0 0
         0 -2.771463e-08 2.3783e-08 0 0 0 0 0 0 0 0
         0 5.511503e-06 4.945406e-06 -1.839432e-06 0 0 0 0 0 0 0
         0 1.73215e-06 -6.926699e-06 -1.353789e-05 4.019687e-06 0 0 0 0 0 0
         0 -4.213482e-06 9.333326e-07 8.930777e-06 1.745584e-07 -2.875373e-06 0 0 0 0 0
         0 -2.646497e-06 -2.046457e-06 -3.307713e-06 -4.346605e-06 -1.044093e-05 7.368941e-06 0 0 0 0
         0 -1.767727e-07 2.381876e-06 2.289896e-06 7.092975e-07 1.400394e-06 1.20922e-06 -1.750367e-06 0 0 0
         0 1.004944e-06 2.157063e-06 1.150316e-06 -5.25921e-07 2.88165e-06 -2.502129e-06 3.112287e-06 2.276247e-06 0 0
         0 2.52272e-07 -1.158783e-06 1.84099e-06 -1.793918e-06 -3.537263e-06 -2.910556e-06 3.564903e-07 -1.95079e-06 2.337577e-06 0
         0 -8.928975e-07 -4.652173e-07 4.070344e-07 1.931351e-06 1.867004e-07 -1.983544e-06 -1.009771e-06 2.340488e-06 -4.437666e-07 -1.602837e-06]),
      Pnm=struct(value=[1 0 1.732051], description="P00, P01, P11"),
      zeta=struct(
        value=[0 0 0 0 0 0 0 0 0 0 0
         0 0 0 0 0 0 0 0 0 0 0
         1.732051 2 0 0 0 0 0 0 0 0 0
         2.44949 3.162278 2.44949 0 0 0 0 0 0 0 0
         3.162278 4.242641 3.741657 2.828427 0 0 0 0 0 0 0
         3.872983 5.291503 4.898979 4.242641 3.162278 0 0 0 0 0 0
         4.582576 6.324555 6 5.477226 4.690416 3.464102 0 0 0 0 0
         5.291503 7.348469 7.071068 6.63325 6 5.09902 3.741657 0 0 0 0
         6 8.3666 8.124038 7.745967 7.211103 6.480741 5.477226 4 0 0 0
         6.708204 9.380832 9.165151 8.831761 8.3666 7.745967 6.928203 5.830952 4.242641 0 0
         7.416198 10.3923 10.19804 9.899495 9.486833 8.944272 8.246211 7.348469 6.164414 4.472136 0],
        description="coefficients to compute the gravitational acceleration"))),
  Mars=struct(mu=struct(value=42828, unit="km^3/s^2")),
  Jupiter=struct(mu=struct(value=126686534, unit="km^3/s^2")),
  Saturn=struct(mu=struct(value=37931187, unit="km^3/s^2")),
  Neptune=struct(mu=struct(value=6836529, unit="km^3/s^2")),
  Pluto=struct(mu=struct(value=871, unit="km^3/s^2")),
  Uranus=struct(mu=struct(value=5793939, unit="km^3/s^2")),
  Date=struct(year=2024, month=10, day=10, hour=12, min=0, sec=0),
  AU=struct(unit="km", description="Astronomical Unit to km conversion", value=149597870.691))

TestData = struct(
  SH=struct(
    n=struct(value=5),
    m=struct(value=5),
    csi=struct(
      value=[0 0 0 0 0 0
       0 0 0 0 0 0
       1.936492 2.236068 0 0 0 0
       1.972027 2.09165 2.645751 0 0 0
       1.984313 2.04939 2.291288 3 0 0
       1.989975 2.03101 2.171241 2.487469 3.316625 0]),
    eta=struct(
      value=[0 0 0 0 0 0
       0 0 0 0 0 0
       1.118034 0 0 0 0 0
       1.01835 0.9354143 0 0 0 0
       1.006231 0.9797959 0.8660254 0 0 0
       1.002853 0.9910312 0.9476071 0.8291562 0 0]),
    zeta=struct(
      value=[0 0 0 0 0 0
       0 0 0 0 0 0
       1.732051 2 0 0 0 0
       2.44949 3.162278 2.44949 0 0 0
       3.162278 4.242641 3.741657 2.828427 0 0
       3.872983 5.291503 4.898979 4.242641 3.162278 0]),
    Pnm=struct(value=[1 0 1.732051]),
    mu=struct(value=398600470000000),
    ref_radius=struct(value=6378139),
    Cnm=struct(
      value=[1 0 0 0 0 0 0 0 0 0 0
       0 0 0 0 0 0 0 0 0 0 0
       -0.00048416544 1.04e-9 2.43404e-6 0 0 0 0 0 0 0 0
       9.5838e-7 2.02855e-6 8.9272e-7 7.0028e-7 0 0 0 0 0 0 0
       5.4112e-7 -5.3521e-7 3.5208e-7 9.885e-7 -1.9531e-7 0 0 0 0 0 0
       6.862e-8 -5.117e-8 6.5146e-7 -4.6712e-7 -2.8754e-7 1.5617e-7 0 0 0 0 0
       0 0 0 0 0 0 0 0 0 0 0
       0 0 0 0 0 0 0 0 0 0 0
       0 0 0 0 0 0 0 0 0 0 0
       0 0 0 0 0 0 0 0 0 0 0
       0 0 0 0 0 0 0 0 0 0 0]),
    Snm=struct(
      value=[0 0 0 0 0 0 0 0 0 0 0
       0 0 0 0 0 0 0 0 0 0 0
       0 -2.43e-9 -1.39907e-6 0 0 0 0 0 0 0 0
       0 2.5197e-7 -6.2346e-7 1.4125e-6 0 0 0 0 0 0 0
       0 -4.6926e-7 6.6404e-7 -2.0179e-7 2.9883e-7 0 0 0 0 0 0
       0 -9.379e-8 -3.2769e-7 -2.0298e-7 4.99e-8 -6.5983e-7 0 0 0 0 0
       0 0 0 0 0 0 0 0 0 0 0
       0 0 0 0 0 0 0 0 0 0 0
       0 0 0 0 0 0 0 0 0 0 0
       0 0 0 0 0 0 0 0 0 0 0
       0 0 0 0 0 0 0 0 0 0 0])))